# Grasshopper definition ModelingAndSimulationFile.gh (Grasshopper 1.0.7)
# plug-ins: DragonflyEnvimet

# 1) Run Ladybug
ladybug = Ladybug_Ladybug()  # -> Vviiiiiiiiiizzz; plug-in component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

# ---- group: Location
constructlocation = Ladybug_ConstructLocation(locationName="MyLocation", latitude="41.45", longitude="15.32", timeZone="1", elevation=0)  # -> location; plug-in component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

# ---- group: Buildings (closed breps or closed meshes)
# 3) Geometries
brep = Brep([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])
brep_2 = Brep(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)

# ---- group: soil
srf = Surface(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)

# ---- group: trees
srf_2 = Surface([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])

# ----
dfreadlibrary = DFEnvimetReadLibrary(_selectMaterial="PROFILE", SearchMaterial_="asphalt")  # -> ProfileId, Description, XML
number_slider = Slider(0, range=0..10)
item = ListItem(List=dfreadlibrary.ProfileId, Index=number_slider, Wrap=True)
item_2 = ListItem(List=dfreadlibrary.Description, Index=number_slider, Wrap=True)
panel = Panel(item_2)

# ---- group: Details
dfxmlreader = DFXMLReader(_XML=dfreadlibrary.XML, _tagName="Albedo")
panel_2 = Panel(dfxmlreader)

# ---- group: Absolute path here!
panel_3 = Panel("C:\...\myFolder")

# ----
merge = Merge(Data1=flatten(brep), Data2=flatten(brep_2))
number_slider_2 = Slider(1.5, range=1..3)

# ----
# 2) Model Settings
dfenvimetmanageworkspace = DFEnvimetManageWorkspace(_projectName_="MorphoModel")
dfenvimetgrid = DFEnvimetGrid(
    StartTelescopeHeight_=5,
    DimX_=number_slider_2,
    DimY_=number_slider_2,
    DimZ_=number_slider_2,
    AddCellsLeft_=2,
    AddCellslRight_=2,
    AddCellsUp_=2,
    AddCellsDown_=2,
    NumCellsZ_=Slider(20, range=1..30))
dfenvimetlocation = DFEnvimetLocation(_location=constructlocation, ModelRotation_=0)

# ---- group: RunIt!
toggle = BooleanToggle(False)

# ----
# 8) EPW -> ENVI_MET
panel_4 = Panel("https://www.energyplus.net/weather-download/europe_wmo_region_6/ITA//ITA_Campobasso.162520_IGDG/all")
epw_stat = Ladybug_OpenEPWAndSTATWeatherFiles(weatherFileURL=panel_4)  # -> epwFile, statFile; plug-in component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
doy_hoy = Ladybug_DOY_HOY(days=Slider(21, range=1..30), months=Slider(6, range=1..12), hours=Slider(7, range=1..24))  # -> HOY, DOY, date; plug-in component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
dfenvimetsimpleforcebyepw = DFEnvimetSimpleForceByEPW(epwFile=epw_stat.epwFile, HOY=doy_hoy.HOY, DOY=doy_hoy.DOY)  # -> readMe, dryBulbTemperature, relativeHumidity, startDate, startTime; plug-in component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

# ---- group: RunIt!
toggle_2 = BooleanToggle(False)

# ----
# 9) Envimet SIM
# 10) Run Simulation with ENVIMET!
dfenvimetconfig = DFEnvimetConfig(Parallel_=True, _runIt=toggle_2)

# ----
# 4) Materials
panel_5 = Panel("MATERIAL")
dfreadlibrary_2 = DFEnvimetReadLibrary(_selectMaterial="MATERIAL", SearchMaterial_="concrete")  # -> MaterialId, Description, XML
dfreadlibrary_3 = DFEnvimetReadLibrary(_selectMaterial=panel_5, SearchMaterial_="brick")  # -> MaterialId, Description, XML
number_slider_3 = Slider(3, range=0..10)
number_slider_4 = Slider(6, range=0..10)
item_3 = ListItem(List=dfreadlibrary_2.MaterialId, Index=number_slider_3, Wrap=True)
item_4 = ListItem(List=dfreadlibrary_2.Description, Index=number_slider_3, Wrap=True)
lng = ListLength(List=brep)
panel_6 = Panel(item_4)

# ---- group: Select material (you can also use Item Selector of HB)
item_5 = ListItem(List=dfreadlibrary_3.MaterialId, Index=number_slider_4, Wrap=True)
item_6 = ListItem(List=dfreadlibrary_3.Description, Index=number_slider_4, Wrap=True)

# ----
panel_7 = Panel(item_6)
dup = DuplicateData(Data=item_5, Number=lng, Order=True)

merge_2 = Merge(Data1=flatten(dup), Data2=flatten(item_3))

# ----
# 5) Envimet objects
dfenvimetbuildings = DFEnvimetBuildings(
    _buildings=merge,
    WallMaterial_=merge_2,
    RoofMaterial_="000000",
    CommonWallMaterial_="000000",
    CommonRoofMaterial_="000000")
dfenvimetsoil = DFEnvimetSoil(_soil=srf, _profileId_=item, BaseSoilmaterial_="000000")
dfenvimet2dplant = DFEnvimet2dPlant(_plant2D=srf_2, _plantId_="0000XX")

toggle_3 = BooleanToggle(True)
# 6) Envimet INX
dfenvimetspaces = DFEnvimetSpaces(
    _envimetFolder=dfenvimetmanageworkspace,
    _envimetLocation=dfenvimetlocation,
    _envimentGrid=dfenvimetgrid,
    _envimetBuidings=dfenvimetbuildings,
    _envimetSoils=dfenvimetsoil,
    Envimet2dPlants_=dfenvimet2dplant,
    FileName_="FactoryExample",
    _runIt=toggle,
    ViewGridXY_=toggle_3,
    ViewGridXZ_=toggle_3,
    ViewGridYZ_=False)  # -> XYGrid, XZGrid, YZGrid, INXfileAddress

dfenvimetconfigsimpleforcing = DFEnvimetConfigSimpleForcing(
    _dryBulbTemperature=dfenvimetsimpleforcebyepw.dryBulbTemperature,
    _relativeHumidity=dfenvimetsimpleforcebyepw.relativeHumidity)
# 7) Envimet SIM preparation
dfenvimetconfigmainsettings = DFEnvimetConfigMainSettings(
    SimName_="DragonflyConfig",
    _INXfileAddress=dfenvimetspaces.INXfileAddress,
    StartDate_=dfenvimetsimpleforcebyepw.startDate,
    StartTime_=dfenvimetsimpleforcebyepw.startTime,
    SimDuration_=24,
    WindSpeed_=3,
    WindDirection_=0,
    Roughness_=0.01,
    InitialTemperature_=21,
    SpecificHumidity_=7,
    RelativeHumidity_=50)
