# Grasshopper definition UWGWorkflow.gh (Grasshopper 1.0.5)

parkingtransitbuildings = Brep([<brep referenced from the Rhino model> x6])
# Import Urban
# Geometry
commercialbuildings = Brep([<brep referenced from the Rhino model> x13])
residentialbuildings = Brep([<brep referenced from the Rhino model> x30])
terrain = Brep(<brep referenced from the Rhino model>)
grass = Brep([<brep referenced from the Rhino model> x4])
trees = Brep([<brep referenced from the Rhino model> x178])

ladybug = Ladybug_Ladybug()  # -> Vviiiiiiiiiizzz; plug-in component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
dragonfly = Dragonfly_Dragonfly()  # -> Vviiiiiiiiiizzz; plug-in component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

# ----
# 1
toggle = BooleanToggle(True)

# ----
# Visualize Urban Area
swatch = ColourSwatch(SwatchColor=RGB(82, 82, 82))
preview = CustomPreview(Geometry=terrain, Shader=swatch)
preview_2 = CustomPreview(Geometry=grass, Shader=ColourSwatch(SwatchColor=RGB(118, 168, 133)))
preview_3 = CustomPreview(Geometry=trees, Shader=ColourSwatch(SwatchColor=RGB(40, 102, 58)))
preview_4 = CustomPreview(Geometry=commercialbuildings, Shader=ColourSwatch(SwatchColor=RGB(95, 100, 178)))
preview_5 = CustomPreview(Geometry=residentialbuildings, Shader=ColourSwatch(SwatchColor=RGB(235, 206, 94)))
preview_6 = CustomPreview(Geometry=parkingtransitbuildings, Shader=ColourSwatch(SwatchColor=RGB(143, 143, 143)))

# ----
# Define Building Typologies
bldgprograms = Dragonfly_bldgPrograms({"FullServiceRestaurant", "Hospital", "LargeHotel", "LargeOffice", "MediumOffice", "MidRiseApartment", "OutPatient", "PrimarySchool", "QuickServiceRestaurant", "SecondarySchool", "SmallHotel", "SmallOffice", "StandAloneRetail", "StripMall", "SuperMarket", "Warehouse"}, selected="LargeOffice")
bldgage = Dragonfly_bldgAge({"Pre-1980's": 0, "1980's-Present": 1, "New Construction": 2}, selected="1980's-Present")
bldgprograms_2 = Dragonfly_bldgPrograms({"FullServiceRestaurant", "Hospital", "LargeHotel", "LargeOffice", "MediumOffice", "MidRiseApartment", "OutPatient", "PrimarySchool", "QuickServiceRestaurant", "SecondarySchool", "SmallHotel", "SmallOffice", "StandAloneRetail", "StripMall", "SuperMarket", "Warehouse"}, selected="MidRiseApartment")
bldgage_2 = Dragonfly_bldgAge({"Pre-1980's": 0, "1980's-Present": 1, "New Construction": 2}, selected="Pre-1980's")
bldgprograms_3 = Dragonfly_bldgPrograms({"FullServiceRestaurant", "Hospital", "LargeHotel", "LargeOffice", "MediumOffice", "MidRiseApartment", "OutPatient", "PrimarySchool", "QuickServiceRestaurant", "SecondarySchool", "SmallHotel", "SmallOffice", "StandAloneRetail", "StripMall", "SuperMarket", "Warehouse"}, selected="Warehouse")
bldgage_3 = Dragonfly_bldgAge({"Pre-1980's": 0, "1980's-Present": 1, "New Construction": 2}, selected="1980's-Present")
bldgtypology = Dragonfly_BuildingTypology(bldgGeo=commercialbuildings, bldgProgram=bldgprograms, bldgAge=bldgage, floor2Floor="4", glzRatio="0.6", runIt=toggle)  # -> readMe, port, DFBldgTypology, port_2, bldgFootprints, bldgFloorBreps, facadeBreps; plug-in component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
bldgtypology_2 = Dragonfly_BuildingTypology(bldgGeo=residentialbuildings, bldgProgram=bldgprograms_2, bldgAge=bldgage_2, runIt=toggle)  # -> readMe, port, DFBldgTypology, port_2, bldgFootprints, bldgFloorBreps, facadeBreps; plug-in component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
bldgtypology_3 = Dragonfly_BuildingTypology(bldgGeo=parkingtransitbuildings, bldgProgram=bldgprograms_3, bldgAge=bldgage_3, floor2Floor="4", runIt=toggle)  # -> readMe, port, DFBldgTypology, port_2, bldgFootprints, bldgFloorBreps, facadeBreps; plug-in component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

# ----
# Define Urban Parameters
panel = Panel("0.25")
vegpar = Dragonfly_VegetationParameters(vegetationAlbedo="0.5")  # -> vegetationPar; plug-in component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
pavementpar = Dragonfly_PavementParameters(albedo=panel)  # -> pavementPar; plug-in component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
trafficpar = Dragonfly_TrafficParameters(sensibleHeat="10")  # -> trafficPar; plug-in component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

exportladybug = Ladybug_ExportLadybug()  # -> readMe; plug-in component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
dragonfly_building_typologies = Panel([bldgtypology.DFBldgTypology, bldgtypology_2.DFBldgTypology, bldgtypology_3.DFBldgTypology])
# 2
toggle_2 = BooleanToggle(True)

# ----
# Import Climate Data
panel_2 = Panel("http://apps1.eere.energy.gov/buildings/energyplus/weatherdata/4_north_and_central_america_wmo_region_4/1_usa/USA_FL_Miami.Intl.AP.722020_TMY3.zip")
epw_stat = Ladybug_OpenEPWAndSTATWeatherFiles(weatherFileURL=panel_2)  # -> epwFile, statFile; plug-in component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

importstat = Ladybug_ImportStat(statFile=epw_stat.statFile)  # -> readMe, ashraeClimateZone, koppenClimateZone, heatingDesignTemps, coolingDesignTemps, heatingDesignDay, coolingDesignDay, monthlyTauBeam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; plug-in component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
# Define the City
city = Dragonfly_City(
    buildingTypologies=flatten([bldgtypology.DFBldgTypology, bldgtypology_2.DFBldgTypology, bldgtypology_3.DFBldgTypology]),
    terrainBrep=flatten(terrain),
    treesOrCoverage=flatten(trees),
    grassOrCoverage=flatten(grass),
    climateZone=importstat.ashraeClimateZone,
    trafficPar=trafficpar,
    vegetationPar=vegpar,
    pavementPar=pavementpar,
    runIt=toggle_2)  # -> readMe, port, DFCity, port_2, treeFootprints, grassFootprints, terrainSrf; plug-in component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
dragonfly_city = Panel(city.DFCity)
# 3
toggle_3 = BooleanToggle(True)

bndlayerpar = Dragonfly_BoundaryLayerParameters()  # -> bndLayerPar; plug-in component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
# Run the UWG
refepwpar = Dragonfly_ReferenceEPWParameters(vegetationCoverage="0.8")  # -> epwSitePar; plug-in component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
runuwg = Dragonfly_RunUrbanWeatherGenerator(
    epwFile=epw_stat.epwFile,
    DFCity=city.DFCity,
    epwSitePar=refepwpar,
    bndLayerPar=bndlayerpar,
    analysisPeriod=importstat.extremeHotWeek,
    write=toggle_3,
    run=toggle_3)  # -> readMe, port, urbanEpw, port_2, uwgObject; plug-in component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

simulation_report = Panel(runuwg.readMe)

# ----
# Visualize the Results
importepw = Ladybug_ImportEpw(epwFile=epw_stat.epwFile)  # -> readMe, latitude, location, dryBulbTemperature, dewPointTemperature, relativeHumidity, windSpeed, windDirection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; plug-in component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
importepw_2 = Ladybug_ImportEpw(epwFile=runuwg.urbanEpw)  # -> readMe, latitude, location, dryBulbTemperature, dewPointTemperature, relativeHumidity, windSpeed, windDirection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; plug-in component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
selectandaveragedata = Ladybug_AverageData(annualHourlyData=importepw_2.dryBulbTemperature, analysisPeriod=importstat.extremeHotWeek)  # -> readMe, selHourlyData, averagedDaily, averagedMonthly, avrMonthlyPerHour, avrMonthlyMinPerHour, avrMonthlyMaxPerHour; plug-in component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
selectandaveragedata_2 = Ladybug_AverageData(annualHourlyData=importepw.dryBulbTemperature, analysisPeriod=importstat.extremeHotWeek)  # -> readMe, selHourlyData, averagedDaily, averagedMonthly, avrMonthlyPerHour, avrMonthlyMinPerHour, avrMonthlyMaxPerHour; plug-in component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
legendpar = Ladybug_LegendParameters(lowBound="24", highBound="35")  # -> legendPar; plug-in component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
_3dchart = Ladybug_3DChart(
    inputData=flatten([selectandaveragedata_2.selHourlyData, selectandaveragedata.selHourlyData]),
    basePoint="300,0,0",
    xScale="2",
    zScale="0",
    legendPar=legendpar)  # -> readMe, graphMesh, graphCurves, legend, legendBasePts, title, titleBasePts, dataPts, conditionalHOY; plug-in component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
