# Grasshopper definition 1_UWGfromBuildingGeometries.gh (Grasshopper 1.0.5)

parkingtransitbuildings = Brep([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])
# Import Urban
# Geometry
commercialbuildings = Brep([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])
residentialbuildings = Brep([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])
terrain = Brep(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)
grass = Brep([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])
trees = Brep([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])

dragonfly = DFDragonfly()  # -> Vviiiiiiiiiizzz; plug-in component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
ladybug = Ladybug_Ladybug()  # -> Vviiiiiiiiiizzz; plug-in component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

# ----
# 1
toggle = BooleanToggle(True)

# ----
# Visualize Urban Area
swatch = ColourSwatch(SwatchColor=RGB(82, 82, 82))
preview = CustomPreview(Geometry=terrain, Shader=swatch)
preview_2 = CustomPreview(Geometry=grass, Shader=ColourSwatch(SwatchColor=RGB(118, 168, 133)))
preview_3 = CustomPreview(Geometry=trees, Shader=ColourSwatch(SwatchColor=RGB(40, 102, 58)))
preview_4 = CustomPreview(Geometry=commercialbuildings, Shader=ColourSwatch(SwatchColor=RGB(95, 100, 178)))
preview_5 = CustomPreview(Geometry=residentialbuildings, Shader=ColourSwatch(SwatchColor=RGB(235, 206, 94)))
preview_6 = CustomPreview(Geometry=parkingtransitbuildings, Shader=ColourSwatch(SwatchColor=RGB(143, 143, 143)))

# ----
# Define Building Typologies
bldg_program = Dragonfly_BldgProgram({"FullServiceRestaurant", "Hospital", "LargeHotel", "LargeOffice", "MediumOffice", "MidRiseApartment", "OutPatient", "PrimarySchool", "QuickServiceRestaurant", "SecondarySchool", "SmallHotel", "SmallOffice", "StandAloneRetail", "StripMall", "SuperMarket", "Warehouse"}, selected="LargeOffice")
bldg_age = Dragonfly_BldgAge({"Pre-1980's": "Pre1980s", "1980's-Present": "1980sPresent", "New Construction": "NewConstruction"}, selected="1980's-Present")
bldg_program_2 = Dragonfly_BldgProgram({"FullServiceRestaurant", "Hospital", "LargeHotel", "LargeOffice", "MediumOffice", "MidRiseApartment", "OutPatient", "PrimarySchool", "QuickServiceRestaurant", "SecondarySchool", "SmallHotel", "SmallOffice", "StandAloneRetail", "StripMall", "SuperMarket", "Warehouse"}, selected="MidRiseApartment")
bldg_age_2 = Dragonfly_BldgAge({"Pre-1980's": "Pre1980s", "1980's-Present": "1980sPresent", "New Construction": "NewConstruction"}, selected="Pre-1980's")
bldg_program_3 = Dragonfly_BldgProgram({"FullServiceRestaurant", "Hospital", "LargeHotel", "LargeOffice", "MediumOffice", "MidRiseApartment", "OutPatient", "PrimarySchool", "QuickServiceRestaurant", "SecondarySchool", "SmallHotel", "SmallOffice", "StandAloneRetail", "StripMall", "SuperMarket", "Warehouse"}, selected="Warehouse")
bldg_age_3 = Dragonfly_BldgAge({"Pre-1980's": "Pre1980s", "1980's-Present": "1980sPresent", "New Construction": "NewConstruction"}, selected="1980's-Present")
bldgtypology = DFBuildingTypology(geo=commercialbuildings, program=bldg_program, age=bldg_age, flr_to_flr="4", run=toggle)  # -> read_me, typology, port, footprints, floors, facades; plug-in component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
bldgtypology_2 = DFBuildingTypology(geo=residentialbuildings, program=bldg_program_2, age=bldg_age_2, run=toggle)  # -> read_me, typology, port, footprints, floors, facades; plug-in component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
bldgtypology_3 = DFBuildingTypology(geo=parkingtransitbuildings, program=bldg_program_3, age=bldg_age_3, flr_to_flr="4", run=toggle)  # -> read_me, typology, port, footprints, floors, facades; plug-in component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

# ----
# Define Urban Parameters
panel = Panel("0.2")
vegpar = DFVegetationParameters(albedo="0.35")  # -> vegetation_par; plug-in component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
pavementpar = DFPavementParameters(albedo=panel)  # -> pavement_par; plug-in component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
trafficpar = DFTrafficParameters(sensible_heat="10")  # -> traffic_par; plug-in component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

# ---- group: Edit Envelope Parameters
typeenvelope = DFEditTypologyEnvelope(typology=bldgtypology.typology, glz_ratio="0.65", shgc="0.35", roof_alb="0.5")  # -> read_me, typology; plug-in component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

# ----
# 2
toggle_2 = BooleanToggle(True)
dragonfly_building_typologies = Panel([typeenvelope.typology, bldgtypology_2.typology, bldgtypology_3.typology])
cityfrompar = DFCityFromParameters()  # -> read_me, DF_city; plug-in component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
importlandsatimg = DFImportLANDSATImage()  # -> readMe, values, geoTiffPts, ptColors, port, legend, legendBasePt, title, titleBasePt; plug-in component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
amyfromncdc = DFAMYFromNCDCData()  # -> readMe, epwFile; plug-in component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

# ----
# Import Climate Data
weather_file = Panel("https://www.energyplus.net/weather-download/north_and_central_america_wmo_region_4/USA/FL/USA_FL_Miami.Intl.AP.722020_TMY3/all")
analysisperiod = Ladybug_AnalysisPeriod(fromMonth="7", toMonth="7", toDay="7")  # -> readMe, analysisPeriod; plug-in component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
epw_stat = Ladybug_OpenEPWAndSTATWeatherFiles(weatherFileURL=weather_file)  # -> epwFile, statFile; plug-in component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

importstat = Ladybug_ImportStat(statFile=epw_stat.statFile)  # -> readMe, ashraeClimateZone, koppenClimateZone, heatingDesignTemps, coolingDesignTemps, heatingDesignDay, coolingDesignDay, monthlyTauBeam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; plug-in component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
# Define the City
city = DFCity(
    typologies=flatten([typeenvelope.typology, bldgtypology_2.typology, bldgtypology_3.typology]),
    terrain=flatten(terrain),
    trees=flatten(trees),
    grass=flatten(grass),
    climate_zone=importstat.ashraeClimateZone,
    traffic_par=trafficpar,
    vegetation_par=vegpar,
    pavement_par=pavementpar,
    run=toggle_2)  # -> read_me, port, city, port_2, tree_proj, grass_proj, terrain_proj; plug-in component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
dragonfly_city = Panel(city.city)
exportladybug = Ladybug_ExportLadybug(components=amyfromncdc.epwFile, targetFolder="C:\Users\chris\Documents\GitHub\Dragonfly", export=Toggle(False))  # -> readMe; plug-in component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
# 3
toggle_3 = BooleanToggle(True)

bndlayerpar = DFBoundaryLayerParameters()  # -> bnd_layer_par; plug-in component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
# Run the UWG
refepwpar = DFReferenceEPWParameters(veg_coverage="0.85")  # -> epw_site_par; plug-in component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
runuwg = DFRunUrbanWeatherGenerator(
    epw_file=epw_stat.epwFile,
    city=city.city,
    epw_site_par=refepwpar,
    bnd_layer_par=bndlayerpar,
    analysis_period=analysisperiod.analysisPeriod,
    write=toggle_3,
    run=toggle_3)  # -> read_me, port, urban_epw, port_2, uwg_object; plug-in component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

# ----
# Visualize the Results
importepw = Ladybug_ImportEpw(epwFile=epw_stat.epwFile)  # -> readMe, latitude, location, dryBulbTemperature, dewPointTemperature, relativeHumidity, windSpeed, windDirection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; plug-in component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
importepw_2 = Ladybug_ImportEpw(epwFile=runuwg.urban_epw)  # -> readMe, latitude, location, dryBulbTemperature, dewPointTemperature, relativeHumidity, windSpeed, windDirection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; plug-in component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
selectandaveragedata = Ladybug_AverageData(annualHourlyData=importepw_2.dryBulbTemperature, analysisPeriod=analysisperiod.analysisPeriod)  # -> readMe, selHourlyData, averagedDaily, averagedMonthly, avrMonthlyPerHour, avrMonthlyMinPerHour, avrMonthlyMaxPerHour; plug-in component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
selectandaveragedata_2 = Ladybug_AverageData(annualHourlyData=importepw.dryBulbTemperature, analysisPeriod=analysisperiod.analysisPeriod)  # -> readMe, selHourlyData, averagedDaily, averagedMonthly, avrMonthlyPerHour, avrMonthlyMinPerHour, avrMonthlyMaxPerHour; plug-in component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
legendpar = Ladybug_LegendParameters(lowBound="26", highBound="36")  # -> legendPar; plug-in component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
_3dchart = Ladybug_3DChart(
    inputData=flatten([selectandaveragedata_2.selHourlyData, selectandaveragedata.selHourlyData]),
    basePoint="300,0,0",
    xScale="2",
    zScale="0",
    legendPar=legendpar)  # -> readMe, graphMesh, graphCurves, legend, legendBasePts, title, titleBasePts, dataPts, conditionalHOY; plug-in component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
