# Grasshopper definition 2_UWGfromBuildingFootprints.gh (Grasshopper 1.0.5)

dragonfly = DFDragonfly()  # -> Vviiiiiiiiiizzz; plug-in component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
ladybug = Ladybug_Ladybug()  # -> Vviiiiiiiiiizzz; plug-in component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

residential = Brep([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])
commercial = Brep([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])
terrain = Brep(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)

# ----
# 1
toggle = BooleanToggle(False)

bldgprograms = Dragonfly_bldgPrograms({"FullServiceRestaurant", "Hospital", "LargeHotel", "LargeOffice", "MediumOffice", "MidRiseApartment", "OutPatient", "PrimarySchool", "QuickServiceRestaurant", "SecondarySchool", "SmallHotel", "SmallOffice", "StandAloneRetail", "StripMall", "SuperMarket", "Warehouse"}, selected="StripMall")
bldgprograms_2 = Dragonfly_bldgPrograms({"FullServiceRestaurant", "Hospital", "LargeHotel", "LargeOffice", "MediumOffice", "MidRiseApartment", "OutPatient", "PrimarySchool", "QuickServiceRestaurant", "SecondarySchool", "SmallHotel", "SmallOffice", "StandAloneRetail", "StripMall", "SuperMarket", "Warehouse"}, selected="MidRiseApartment")
bldgage = Dragonfly_bldgAge({"Pre-1980's": 0, "1980's-Present": 1, "New Construction": 2}, selected="Pre-1980's")
bldgage_2 = Dragonfly_bldgAge({"Pre-1980's": 0, "1980's-Present": 1, "New Construction": 2}, selected="Pre-1980's")
# Define Building
# Typologies
footprinttypology = DFTypologyFromFootprints(geo=residential, num_floors="2.5", program=bldgprograms_2, age=bldgage_2, run=toggle)  # -> read_me, port, typology, port_2, perim_crvs; plug-in component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
footprinttypology_2 = DFTypologyFromFootprints(geo=commercial, num_floors="3", program=bldgprograms, age=bldgage, run=toggle)  # -> read_me, port, typology, port_2, perim_crvs; plug-in component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

building_typologies = Panel([footprinttypology.typology, footprinttypology_2.typology])
# 2
toggle_2 = BooleanToggle(False)

# ----
# Import Climate Data
weather_file = Panel("https://www.energyplus.net/weather-download/europe_wmo_region_6/DEU//DEU_Munich.108660_IWEC/all")
analysisperiod = Ladybug_AnalysisPeriod(fromMonth="7", toMonth="7", toDay="7")  # -> readMe, analysisPeriod; plug-in component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
epw_stat = Ladybug_OpenEPWAndSTATWeatherFiles(weatherFileURL=weather_file)  # -> epwFile, statFile; plug-in component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

importstat = Ladybug_ImportStat(statFile=epw_stat.statFile)  # -> readMe, ashraeClimateZone, koppenClimateZone, heatingDesignTemps, coolingDesignTemps, heatingDesignDay, coolingDesignDay, monthlyTauBeam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; plug-in component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
trafficpar = DFTrafficParameters(sensible_heat="8")  # -> traffic_par; plug-in component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
# Define the City
city = DFCity(
    typologies=flatten([footprinttypology.typology, footprinttypology_2.typology]),
    terrain=flatten(terrain),
    trees=flatten("0.05"),
    climate_zone=importstat.ashraeClimateZone,
    traffic_par=trafficpar,
    run=toggle_2)  # -> read_me, port, city, port_2, tree_proj, grass_proj, terrain_proj; plug-in component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

city_2 = Panel(city.city)
# 3
toggle_3 = BooleanToggle(False)
# Run the UWG
runuwg = DFRunUrbanWeatherGenerator(epw_file=epw_stat.epwFile, city=city.city, analysis_period=analysisperiod.analysisPeriod, write=toggle_3, run=toggle_3)  # -> read_me, port, urban_epw, port_2, uwg_object; plug-in component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
urban_epw = Panel(runuwg.urban_epw)
