# Grasshopper definition 3_UWGfromParameters.gh (Grasshopper 1.0.5)

ladybug = Ladybug_Ladybug()  # -> Vviiiiiiiiiizzz; plug-in component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
dragonfly = Dragonfly_Dragonfly()  # -> Vviiiiiiiiiizzz; plug-in component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

# ----
# Import Climate Data
weather_file = Panel("https://www.energyplus.net/weather-download/north_and_central_america_wmo_region_4/USA/NY/USA_NY_New.York-J.F.Kennedy.Intl.AP.744860_TMY3/all")
epw_stat = Ladybug_OpenEPWAndSTATWeatherFiles(weatherFileURL=weather_file)  # -> epwFile, statFile; plug-in component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

importstat = Ladybug_ImportStat(statFile=epw_stat.statFile)  # -> readMe, ashraeClimateZone, koppenClimateZone, heatingDesignTemps, coolingDesignTemps, heatingDesignDay, coolingDesignDay, monthlyTauBeam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; plug-in component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

# ----
# Define Urban Parameters
panel = Panel("0.2")
pavementpar = Dragonfly_PavementParameters(albedo=panel)  # -> pavement_par; plug-in component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
vegpar = Dragonfly_VegetationParameters(albedo="0.45")  # -> vegetation_par; plug-in component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
trafficpar = Dragonfly_TrafficParameters(sensible_heat="10")  # -> traffic_par; plug-in component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

# ---- group: Building Typologies
bldg_program = Dragonfly_bldgPrograms({"FullServiceRestaurant", "Hospital", "LargeHotel", "LargeOffice", "MediumOffice", "MidRiseApartment", "OutPatient", "PrimarySchool", "QuickServiceRestaurant", "SecondarySchool", "SmallHotel", "SmallOffice", "StandAloneRetail", "StripMall", "SuperMarket", "Warehouse"}, selected="LargeOffice")
bldg_program_2 = Dragonfly_bldgPrograms({"FullServiceRestaurant", "Hospital", "LargeHotel", "LargeOffice", "MediumOffice", "MidRiseApartment", "OutPatient", "PrimarySchool", "QuickServiceRestaurant", "SecondarySchool", "SmallHotel", "SmallOffice", "StandAloneRetail", "StripMall", "SuperMarket", "Warehouse"}, selected="MidRiseApartment")
bldg_age = Dragonfly_bldgAge({"Pre-1980's": "Pre1980s", "1980's-Present": "1980sPresent", "New Construction": "NewConstruction"}, selected="New Construction")
bldg_age_2 = Dragonfly_bldgAge({"Pre-1980's": "Pre1980s", "1980's-Present": "1980sPresent", "New Construction": "NewConstruction"}, selected="New Construction")
panel_2 = Panel("""0.6
0.4""")

# ----
# 1
toggle = BooleanToggle(False)

# ---- group: Geometry Params
panel_3 = Panel("2")
panel_4 = Panel("60")
panel_5 = Panel("0.5")

# ----
# Define the City
cityfrompar = Dragonfly_CityFomParameters(
    avg_height=panel_4,
    site_coverage=panel_5,
    facade_to_site=panel_3,
    bldg_programs=[bldg_program, bldg_program_2],
    bldg_ages=[bldg_age, bldg_age_2],
    bldg_ratios=panel_2,
    tree_coverage="0.2",
    grass_coverage="0.2",
    climate_zone=importstat.ashraeClimateZone,
    traffic_par=trafficpar,
    vegetation_par=vegpar,
    pavement_par=pavementpar,
    run=toggle)  # -> read_me, DF_city; plug-in component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
dragonfly_city = Panel(cityfrompar.DF_city)

analysisperiod = Ladybug_AnalysisPeriod(fromMonth="1", toMonth="1")  # -> readMe, analysisPeriod; plug-in component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

# ----
# 2
toggle_2 = BooleanToggle(False)
# Run the UWG
runuwg = Dragonfly_RunUrbanWeatherGenerator(
    epw_file=epw_stat.epwFile,
    DF_city=cityfrompar.DF_city,
    analysis_period=analysisperiod.analysisPeriod,
    write=toggle_2,
    run=toggle_2)  # -> read_me, port, urban_epw, port_2, uwg_object; plug-in component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
urban_epw = Panel(runuwg.urban_epw)
