# Grasshopper definition importDFLibraries.gh (Grasshopper 0.9.76)
# plug-ins: Python Interpreter

python = PythonScript()  # -> out, a
# ---------- python: Python ----------
import sys
pathToLibs = "C:\\Users\\mackey\\Documents\\GitHub\\Dragonfly\\"

if not pathToLibs in sys.path:
    sys.path.append(pathToLibs)

import dragonflyx
# ---------- end python ----------
